# Grasshopper definition Handset.gh (Grasshopper 1.0.8)
# plug-ins: Pufferfish, Human, OpenNest, ShapeDiverForGrasshopper

# ----
# Table frame import
panel = Panel("D:\Archarm_test\Archarm_test\Models\Table_frame.stp")
geo = Geometry([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])

# ----
# Base
number_slider = Slider(0, range=0..36)
# Table frame
merge = Merge(Data1=number_slider, Data2=Slider(1, range=0..36), Data3=Slider(7, range=0..36), Data4=Slider(4, range=0..36))
item = ListItem(List=geo, Index=merge, Wrap=True)

# ----
# Segment 1
number_slider_2 = Slider(3, range=0..36)
item_2 = ListItem(List=geo, Index=number_slider_2, Wrap=True)

# ----
# Board support
number_slider_3 = Slider(2, range=0..36)
item_3 = ListItem(List=geo, Index=number_slider_3, Wrap=True)

# ----
# Horisontal extension bars
number_slider_4 = Slider(14, range=0..36)
merge_2 = Merge(Data1=Slider(13, range=0..36), Data2=number_slider_4)
item_4 = ListItem(List=geo, Index=merge_2, Wrap=True)

# ----
# Vertical moving
vertical_moving = Slider(81, range=0..100)
hrisontal_moving_group = Merge(Data1=item_3, Data2=item_4)
Z = UnitZ(Factor=vertical_moving)
division = Division(A=vertical_moving, B=2)
Z_2 = UnitZ(Factor=division)
move = Move(Geometry=hrisontal_moving_group, Motion=Z)  # -> Geometry, Transform
move_2 = Move(Geometry=item_2, Motion=Z_2)  # -> Geometry, Transform
hrisontal_moving_group_2 = Merge(Data1=move.Geometry, Data2=move_2.Geometry)

# ----
# Highest point calc
bboxedges = BBoxEdges(Geo=item_3)  # -> Line0, Line1, Dist0, Dist1, Box
debrep = DeconstructBrep(Brep=bboxedges.Box)  # -> Faces, Edges, Vertices
item_5 = ListItem(List=debrep.Faces, Index=Slider(5, range=0..10), Wrap=True)
pcen = PolygonCenter(Polyline=item_5)  # -> CenterV, CenterE, CenterA
pdecon = Deconstruct(Point=pcen.CenterV)  # -> XComponent, YComponent, ZComponent

# ----
# Extension bars separation
number_slider_5 = Slider(0, range=0..1)
merge_3 = Merge(Data1=number_slider_5, Data2=Slider(3, range=0..3))
dispdexs = DispatchIndices(List=hrisontal_moving_group_2, Indices=merge_3)  # -> AtI, NotI

# ----
# Handset material
panel_2 = Panel("https://github.com/Svi-ra/Archarm_test/blob/main/Textures/Handset/Handset_DefaultMaterial_MRT.jpg?raw=true")
panel_3 = Panel("https://github.com/Svi-ra/Archarm_test/blob/main/Textures/Handset/Handset_DefaultMaterial_Normal.png?raw=true")
panel_4 = Panel("https://github.com/Svi-ra/Archarm_test/blob/main/Textures/Handset/Handset_DefaultMaterial_BaseColor.jpg?raw=true")
gltf2material = GlTF20Material(
    BaseColorFactor=RGB(255, 255, 255),
    BaseColorTexture=panel_4,
    MetallicFactor=0,
    RoughnessFactor=1,
    MetallicRoughnessTexture=panel_2,
    NormalTexture=panel_3,
    EmissiveFactor=RGB(0, 0, 0),
    AlphaMode="OPAQUE",
    AlphaCutoff=0.5,
    DoubleSided=True)

# ----
# Metal material
# https://github.com/Svi-ra/Archarm_test/blob/main/Textures/Metal/sgupceqc_2K_Normal.jpg?raw=true
panel_5 = Panel("https://github.com/Svi-ra/Archarm_test/blob/main/Textures/Metal/sgupceqc_2K_Albedo.jpg?raw=true")
panel_6 = Panel("https://github.com/Svi-ra/Archarm_test/blob/main/Textures/Metal/Metal_MRT.png?raw=true")
gltf2material_2 = GlTF20Material(
    BaseColorFactor=RGB(255, 255, 255),
    BaseColorTexture=panel_5,
    MetallicFactor=0,
    RoughnessFactor=1,
    MetallicRoughnessTexture=panel_6,
    EmissiveFactor=RGB(0, 0, 0),
    AlphaMode="OPAQUE",
    AlphaCutoff=0.5,
    DoubleSided=True)

merge_4 = Merge(Data1=item, Data2=dispdexs.AtI)

# ----
# Carbon material
gltf2material_3 = GlTF20Material(
    BaseColorFactor=RGB(255, 255, 255),
    MetallicFactor=0,
    RoughnessFactor=1,
    EmissiveFactor=RGB(0, 0, 0),
    AlphaMode="OPAQUE",
    AlphaCutoff=0.5,
    DoubleSided=True)

# ----
# Handset
panel_7 = Panel("D:\Archarm_test\Archarm_test\Models\Handset_1.fbx")
yz = YZPlane(Origin=Point(0, 0, 0))
geo_2 = Geometry(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)
rotate = Rotate(Geometry=geo_2, Angle=1.570796327, Plane=yz)  # -> Geometry, Transform
Z_3 = UnitZ(Factor=pdecon.ZComponent)
move_3 = Move(Geometry=rotate.Geometry, Motion=Z_3)  # -> Geometry, Transform
Z_4 = UnitZ(Factor=Z)
move_4 = Move(Geometry=move_3.Geometry, Motion=Z_4)  # -> Geometry, Transform
handset_offset_from_board_edge = Slider(167, range=0..1000)

# ----
# Board
number_slider_6 = Slider(1416, range=0..1500)
board_depth = Slider(812, range=0..1500)
board_thickness = Slider(18, range=0..100)
scale = Scale(A=board_depth)
Z_5 = UnitZ(Factor=board_thickness)
Z_6 = UnitZ(Factor=pdecon.ZComponent)

multiplication = Multiplication(A=board_depth, B=-0.5)
X = UnitX(Factor=multiplication)
move_5 = Move(Geometry=move_4.Geometry, Motion=X)  # -> Geometry, Transform

# ----
# Horisontal moving
horisontal_moving = Slider(100, range=0..100)

double = Multiplication(A=horisontal_moving, B=2)
addition = Addition(A=number_slider_6, B=double)
scale_2 = Scale(A=addition)
planesrf = PlaneSurface(Plane=PlaneXY(0, 0, 0), XSize=scale, YSize=scale_2)
extr = Extrude(Base=planesrf, Direction=Z_5)
move_6 = Move(Geometry=extr, Motion=Z_6)  # -> Geometry, Transform
move_7 = Move(Geometry=move_6.Geometry, Motion=Z)  # -> Geometry, Transform

multiplication_2 = Multiplication(A=addition, B=-0.5)
addition_2 = Addition(A=multiplication_2, B=handset_offset_from_board_edge)
Y = UnitY(Factor=addition_2)
move_8 = Move(Geometry=move_5.Geometry, Motion=Y)  # -> Geometry, Transform

# ----
# Box texture mapping
number_slider_7 = Slider(468, range=0..3000)
scale_3 = Scale(A=number_slider_7)
box = CenterBox(Base=PlaneXY(0, 0, 0), X=scale_3, Y=scale_3, Z=scale_3)
boxmap = BoxMapping(Mesh=move_7.Geometry, Box=box)

neg = Negative(Value=horisontal_moving)

Y_2 = UnitY(Factor=neg)
move_9 = Move(Geometry=merge_4, Motion=Y_2)  # -> Geometry, Transform

# ----
# Mirror
xz = XZPlane(Origin=Point(0, 0, 0))
mirror = Mirror(Geometry=move_9.Geometry, Plane=xz)  # -> Geometry, Transform

gltfdisplay = GlTF20Display(Geometry=move_8.Geometry, Material=gltf2material)
gltfdisplay_2 = GlTF20Display(Geometry=boxmap, Material=gltf2material_3)
merge_5 = Merge(Data1=dispdexs.NotI, Data2=move_9.Geometry, Data3=mirror.Geometry)
gltfdisplay_3 = GlTF20Display(Geometry=merge_5, Material=gltf2material_2)

# ==== cluster Scale
A = ClusterInput()
division = Division(A=A, B=2)
neg = Negative(Value=division)
dom = ConstructDomain(DomainStart=division, DomainEnd=neg)
I = ClusterOutput(dom)
