# Grasshopper definition Test.gh (Grasshopper 1.0.8)
# plug-ins: ShapeDiverForGrasshopper

sph = Sphere(Base=PlaneXY(0, 0, 0), Radius=Slider(120, range=0..1000))
gltf2material = GlTF20Material(
    BaseColorFactor=RGB(255, 255, 255),
    MetallicFactor=0,
    RoughnessFactor=1,
    EmissiveFactor=RGB(0, 0, 0),
    AlphaMode="OPAQUE",
    AlphaCutoff=0.5,
    DoubleSided=True)
gltf2material_2 = GlTF20Material(
    BaseColorFactor=RGB(255, 255, 255),
    MetallicFactor=0,
    RoughnessFactor=1,
    EmissiveFactor=RGB(0, 0, 0),
    AlphaMode="OPAQUE",
    AlphaCutoff=0.5,
    DoubleSided=True)
Z = UnitZ(Factor=Slider(377, range=0..1000))
move = Move(Geometry=sph, Motion=Z)  # -> Geometry, Transform
gltfdisplay = GlTF20Display(Geometry=sph, Material=gltf2material)
gltfdisplay_2 = GlTF20Display(Geometry=move.Geometry, Material=gltf2material_2)
